# Dynamo graph Join_by_category_v3_WebRequest.dyn (Dynamo 1.3.4.6666)

# group: Python file from Github
forceChildrensEval = ForceChildrensEval()  # unwired: arg0
webRequestGitHab = Python(IN[0]=forceChildrensEval)
# ---------- webRequestGitHab.python (42 lines) ----------
# -*- coding: utf-8 -*- 
#region-----------------Импоорт библиотек----------------------
import clr
import sys 
sys.path.append("C:\Program Files (x86)\IronPython 2.7\Lib")
import os
import System
from System import Guid
from System import DateTime
from System.IO import StreamReader
from System.Net import WebRequest, HttpRequestHeader
clr.AddReference('System.Web.Extensions')
from System.Web.Script.Serialization import JavaScriptSerializer 
from System import Type, Activator, IO, Text, Uri, Convert
#endregion--------------Импоорт библиотек----------------------
file_path = 'C:\\temp\\githab_code.py'
#region-----------------ФУНКЦИИ----------------------
def LogSaveStrList(string_list):
	IO.File.AppendAllLines(file_path, flatten(string_list), Text.Encoding.Unicode)
def LogSaveStr(string):
	IO.File.WriteAllText(file_path, string, Text.Encoding.Unicode)
def rsnrequest():
	request = WebRequest.Create('https://api.github.com/repos/Babinoff/Join_Unjoin/contents/Join_by_category_main.py?ref=master')
	request.Method = "GET"
	request.UserAgent = "Anything"
	#token = '2f4c54160568dad4f3cd002ab358d9bf935ef133'
	#request.Headers["OAUTH-TOKEN"] = token
	rsp = request.GetResponse()
	stream_reader = StreamReader(rsp.GetResponseStream())
	jsonData = stream_reader.ReadToEnd()
	stream_reader.Close()
	json = JavaScriptSerializer().DeserializeObject(jsonData)
	return json
#endregion-------------ФУНКЦИИ----------------------
#region-----------------MAIN----------------------
json_recv = rsnrequest()
data_from_json = json_recv["content"]
base64EncodedBytes = System.Convert.FromBase64String(data_from_json)
python_code_string = System.Text.Encoding.UTF8.GetString(base64EncodedBytes)
LogSaveStr(python_code_string)
#endregion--------------MAIN----------------------
OUT = python_code_string
# ----------------------------------------

список_категорий = StringInput("Части, Стены, Перекрытия, Несущие колонны, Каркас несущий")
true_объединить_геометрию_false = BoolSelector(true)  # "True - Объединить геометрию /// False - Разделить геометрию"
python_script_from_string = PythonStringNode(script=webRequestGitHab, IN[0]=список_категорий, IN[1]=true_объединить_геометрию_false)

# group: Local Python file
путь_к_файлу_python = Filename(".\Join_by_category_main.py")
forceChildrensEval_2 = ForceChildrensEval(путь_к_файлу_python)
find_file_and_import_it = Python(IN[0]=forceChildrensEval_2)
# ---------- find_file_and_import_it.python (11 lines) ----------
import sys
sys.path.append('C:\Program Files (x86)\IronPython 2.7\Lib')
import codecs

try:
	filePath = IN[0]
	with codecs.open(filePath, 'rb', "utf-8") as inf:
		lines = inf.readlines()
	OUT = ''.join(lines)
except:
	OUT = "No file"
# ----------------------------------------
